% Simulink data dictionary LQR.sldd

Cf = 30989
Cr = 50154
Iz = 111.8
K1 = [2.290442 1.884746 1.324242 0.6287857 -0.1585896]
K2 = [6.391301 6.667749 6.884763 7.116567 7.367182]
K3 = repmat(-83.666, 1, 5)
Velocity = [21.8330446; 21.8588473; 21.8806381; 21.8990476; 21.9146054; 21.9277569; 21.9388766; 21.9482803; 21.9562341; 21.9629624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 21.8330446]
Yawrate = [-0.3268057; -0.3176418; -0.2994956; -0.2723563; -0.2449176; -0.2184312; -0.1929327; -0.1773509; -0.1653787; -0.1566135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 -0.3268057]
lf = 0.783
lr = 0.752
m = 245

ref_yalmip = [-7.135164 -0.3268057
 -6.943284 -0.3176418
 -6.553155 -0.2994956
 -5.964343 -0.2723563
 -5.367273 -0.2449176
 -4.789705 -0.2184312
 -4.232726 -0.1929327
 -3.892547 -0.1773509
 -3.631094 -0.1653787
 -3.439696 -0.1566135
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 ]

time_interval = 0.1190559
u = Simulink.Signal(Unit="test", InitialValue="0")